# Dynamo graph Rectangular Grid 670607-generative-sublist.dyn (Dynamo 2.18.1.5096)
# packages: Structural Analysis for Dynamo 2.17.0

# group: Parameter
hight = DoubleSlider(4, range=2.5..4 step 0.5)  # graph input
x_span_length = DoubleSlider(3, range=3..8 step 1)  # graph input
number_of_bay_x = DoubleSlider(3, range=2..10 step 1)  # graph input
y_span_length = DoubleSlider(3, range=3..8 step 1)  # graph input
number_of_bay_y = DoubleSlider(3, range=2..10 step 1)  # graph input
number_of_storie = DoubleSlider(3, range=1..8 step 1)  # graph input

code_block = CodeBlock(H=hight) { 0; H; }

# group: Load ( Dead Load And Live Load )
slab_weight = DoubleInput(-300)
super_dead_load_on_floor = DoubleInput(-150)
dead_load_on_floor = slab_weight + super_dead_load_on_floor
code_block_2 = CodeBlock { 1; }
dead_load_on_beam = dead_load_on_floor * code_block_2
wall_load = DoubleInput(-100)
wall_load_on_beam = wall_load * code_block_2
live_load_on_floor = DoubleInput(-300)
live_load_on_beam = live_load_on_floor * code_block_2
list_create = List.Create(item0=dead_load_on_beam, item1=wall_load_on_beam, item2=live_load_on_beam)
sum = Math.Sum(values=list_create)

code_block_3 = CodeBlock { 1; }
code_block_4 = CodeBlock { 2400; }
code_block_5 = CodeBlock(Fy=code_block_4) { 0.6*Fy; }

# group: จัดรูปแบบเสา
byCoordinates = Point.ByCoordinates(x=code_block.out0, y=code_block.out0, z=code_block.out0)
byCoordinates_2 = Point.ByCoordinates(x=code_block.out0, y=code_block.out0, z=code_block.H)
column_line_bystartpointendpoint = Line.ByStartPointEndPoint(startPoint=byCoordinates, endPoint=byCoordinates_2)
code_block_6 = CodeBlock { 0..2; }
code_block_7 = CodeBlock { 1; }
sections = SectionBar("H 100x100x17.2")

# group: จัดรูปแบบคาน แกน X
code_block_8 = CodeBlock(x_span_length=x_span_length, div=number_of_bay_x) { 0..x_span_length*(div-1)..#div; }
byCoordinates_3 = Point.ByCoordinates(x=code_block.out0, y=code_block.out0, z=code_block.H)
byCoordinates_4 = Point.ByCoordinates(x=x_span_length, y=code_block.out0, z=code_block.H)
beam_x_line_bystartpointendpoint = Line.ByStartPointEndPoint(startPoint=byCoordinates_3, endPoint=byCoordinates_4)
translate = Geometry.Translate(geometry=beam_x_line_bystartpointendpoint, xTranslation=code_block_8)
count = List.Count(list=translate)
code_block_9 = CodeBlock(x=count) { x-1; }
removeItemAtIndex = List.RemoveItemAtIndex(list=translate, indices=code_block_9)
code_block_10 = CodeBlock { 0..2; }
code_block_11 = CodeBlock { 1; }
sections_2 = SectionBar("H 100x100x17.2")

# group (continued): จัดรูปแบบเสา
translate_2 = Geometry.Translate(geometry=column_line_bystartpointendpoint, xTranslation=code_block_8)

# group: จัดรูปแบบคาน แกน Y
code_block_12 = CodeBlock(y_span_length=y_span_length, div=number_of_bay_y) { 0..y_span_length*(div-1)..#div; }
byCoordinates_5 = Point.ByCoordinates(x=code_block.out0, y=code_block.out0, z=code_block.H)
byCoordinates_6 = Point.ByCoordinates(x=code_block.out0, y=y_span_length, z=code_block.H)
beam_y_line_bystartpointendpoint = Line.ByStartPointEndPoint(startPoint=byCoordinates_5, endPoint=byCoordinates_6)
translate_3 = Geometry.Translate(geometry=beam_y_line_bystartpointendpoint, yTranslation=code_block_12)
count_2 = List.Count(list=translate_3)
code_block_13 = CodeBlock(y=count_2) { y-1; }
removeItemAtIndex_2 = List.RemoveItemAtIndex(list=translate_3, indices=code_block_13)
translate_4 = Geometry.Translate(geometry=removeItemAtIndex_2, xTranslation=code_block_8, lacing=CrossProduct)
code_block_14 = CodeBlock { 0..2; }
code_block_15 = CodeBlock { 1; }
sections_3 = SectionBar("H 100x100x17.2")

# group (continued): จัดรูปแบบเสา
translate_5 = Geometry.Translate(geometry=translate_2, yTranslation=code_block_12, lacing=CrossProduct)

# group (continued): จัดรูปแบบคาน แกน X
translate_6 = Geometry.Translate(geometry=removeItemAtIndex, yTranslation=code_block_12, lacing=CrossProduct)

# group: จัดรูปทรงโครงสร้าง
list_create_2 = List.Create(item0=translate_5, item1=translate_6, item2=translate_4)
code_block_16 = CodeBlock(H=code_block.H, Storie=number_of_storie) { 0..H*(Storie-1)..H; }
translate_7 = Geometry.Translate(geometry=list_create_2, zTranslation=code_block_16, lacing=CrossProduct)

# group: Suppot
byLines = DynamoSimulation.RSA.AnalyticalModel.AnalyticalBar.ByLines(lines=translate_5)
startNode = DynamoSimulation.RSA.AnalyticalModel.AnalyticalBar.StartNode(analyticalBar=byLines)
watch = Watch(startNode)
supports = Support("Fixed")
setSupportByName = DynamoSimulation.RSA.AnalyticalModel.AnalyticalNode.SetSupportByName(nodes=startNode, name=supports)

# group (continued): จัดรูปแบบเสา
translate_8 = Geometry.Translate(geometry=translate_5, zTranslation=code_block_16, lacing=CrossProduct)
transpose = List.Transpose(lists=translate_8)
sublists = List.Sublists(list=transpose, ranges=code_block_6, offset=code_block_7)
byLines_2 = DynamoSimulation.RSA.AnalyticalModel.AnalyticalBar.ByLines(lines=sublists)
setSectionByName = DynamoSimulation.RSA.AnalyticalModel.AnalyticalBar.SetSectionByName(analyticalBars=byLines_2, name=sections)

# group (continued): จัดรูปแบบคาน แกน X
translate_9 = Geometry.Translate(geometry=translate_6, zTranslation=code_block_16, lacing=CrossProduct)
transpose_2 = List.Transpose(lists=translate_9)
sublists_2 = List.Sublists(list=transpose_2, ranges=code_block_10, offset=code_block_11)
byLines_3 = DynamoSimulation.RSA.AnalyticalModel.AnalyticalBar.ByLines(lines=sublists_2)
setSectionByName_2 = DynamoSimulation.RSA.AnalyticalModel.AnalyticalBar.SetSectionByName(analyticalBars=byLines_3, name=sections_2)

# group (continued): จัดรูปแบบคาน แกน Y
translate_10 = Geometry.Translate(geometry=translate_4, zTranslation=code_block_16, lacing=CrossProduct)
transpose_3 = List.Transpose(lists=translate_10)
sublists_3 = List.Sublists(list=transpose_3, ranges=code_block_14, offset=code_block_15)
byLines_4 = DynamoSimulation.RSA.AnalyticalModel.AnalyticalBar.ByLines(lines=sublists_3)
setSectionByName_3 = DynamoSimulation.RSA.AnalyticalModel.AnalyticalBar.SetSectionByName(analyticalBars=byLines_4, name=sections_3)

# group: Load Case by Member Group
list_create_3 = List.Create(item0=setSectionByName, item1=setSectionByName_2, item2=setSectionByName_3)
case_nature = CaseNature("Dead")
code_block_17 = CodeBlock { "DL1"; }
byNature = DynamoSimulation.RSA.AnalyticalModel.Loads.LoadCase.ByNature(caseNature=case_nature, caseName=code_block_17)
byBars = DynamoSimulation.RSA.AnalyticalModel.Loads.UniformMemberLoad.ByBars(analyticalBars=list_create_3, loadCase=byNature, fz=sum)
watch_2 = Watch(byBars)

# group: Calculate
list_create_4 = List.Create(item0=setSectionByName, item1=setSectionByName_2, item2=setSectionByName_3, item3=byBars, item4=setSupportByName, item5=byNature)
flatten = List.Flatten(list=list_create_4)
calculate = DynamoSimulation.RSA.Analysis.Calculate(elements=flatten)

# group: คำนวณ Bending Moment --> Section Req.
code_block_18 = CodeBlock { "SmaxMY"; }
getMaxValuesList = DynamoSimulation.RSA.RSAResults.Bar.BarStresses.GetMaxValuesList(name=code_block_18, analyticalBars=calculate.analyticalBars, loadCasesIds=code_block_3)
flatten_2 = List.Flatten(list=getMaxValuesList)
abs = Math.Abs(number=flatten_2)
section_req = CodeBlock(M=abs, Fy=code_block_5) { (M/100)/Fy; }

# group: ความยาวแต่ละจุดต่อของ Member
startNode_2 = DynamoSimulation.RSA.AnalyticalModel.AnalyticalBar.StartNode(analyticalBar=calculate.analyticalBars)
X = DynamoSimulation.RSA.AnalyticalModel.AnalyticalNode.X(analyticalNode=startNode_2)
Y = DynamoSimulation.RSA.AnalyticalModel.AnalyticalNode.Y(analyticalNode=startNode_2)
Z = DynamoSimulation.RSA.AnalyticalModel.AnalyticalNode.Z(analyticalNode=startNode_2)
byCoordinates_7 = Point.ByCoordinates(x=X, y=Y, z=Z)
endNode = DynamoSimulation.RSA.AnalyticalModel.AnalyticalBar.EndNode(analyticalBar=calculate.analyticalBars)
X_2 = DynamoSimulation.RSA.AnalyticalModel.AnalyticalNode.X(analyticalNode=endNode)
Y_2 = DynamoSimulation.RSA.AnalyticalModel.AnalyticalNode.Y(analyticalNode=endNode)
Z_2 = DynamoSimulation.RSA.AnalyticalModel.AnalyticalNode.Z(analyticalNode=endNode)
byCoordinates_8 = Point.ByCoordinates(x=X_2, y=Y_2, z=Z_2)
distanceTo = Geometry.DistanceTo(geometry=byCoordinates_7, other=byCoordinates_8)

# group: Python - คำนวณเหล็กรูปพรรณตามตารางเหล็ก
python_script = Python(IN[0]=section_req)  # CPython3
# ---------- python_script.python (85 lines) ----------
# Load the Python Standard and DesignScript Libraries
import sys
import clr
clr.AddReference('ProtoGeometry')
from Autodesk.DesignScript.Geometry import *

# The inputs to this node will be stored as a list in the IN variables.
Sx_list = IN[0]  # เปลี่ยนชื่อตัวแปรจาก Sx เป็น Sx_list เพื่อแสดงให้เห็นว่าเป็น list

# Place your code below this line
result = []  # สร้าง list เพื่อเก็บผลลัพธ์ที่ได้จากแต่ละค่าใน Sx_list
for Sx in Sx_list:
    if Sx <= 184:
        w = 21.3
        Section_area = 27.16
        Section = 'H-200x100x21.3 kg/m'
    elif Sx <= 324:
        w = 29.6
        Section_area = 37.66
        Section = 'H-250x125x29.6 kg/m'
    elif Sx <= 481:
        w = 36.7
        Section_area = 46.78
        Section = 'H-300x150x36.7 kg/m'
    elif Sx <= 775:
        w = 49.6
        Section_area = 63.14
        Section = 'H-350x175x49.6 kg/m'
    elif Sx <= 1190:
        w = 66
        Section_area = 84.12
        Section = 'H-400x200x66.0 kg/m'
    elif Sx <= 1490:
        w = 76
        Section_area = 96.76
        Section = 'H-450x200x76.0 kg/m'
    elif Sx <= 1910:
        w = 89.6
        Section_area = 114.20
        Section = 'H-500x200x89.6 kg/m'
    elif Sx <= 2590:
        w = 106
        Section_area = 134.40
        Section = 'H-600x200x106 kg/m'
    elif Sx <= 3530:
        w = 137
        Section_area = 174.50
        Section = 'H-600x300x137 kg/m'
    elif Sx <= 7290:
        w = 210
        Section_area = 267.40
        Section = 'H-800x300x210 kg/m'
    elif Sx <= 9140:
        w = 243
        Section_area = 309.80
        Section = 'H-900x300x243 kg/m'
    elif Sx <= 219:
        w = 31.5
        Section_area = 40.14
        Section = 'H-150x150x31.5 kg/m'
    elif Sx <= 330:
        w = 40.2
        Section_area = 51.21
        Section = 'H-175x175x40.2 kg/m'
    elif Sx <= 472:
        w = 49.9
        Section_area = 63.53
        Section = 'H-200x200x49.9 kg/m'  
    elif Sx <= 1360:
        w = 94
        Section_area = 119.80
        Section = 'H-300x300x94.0 kg/m'
    elif Sx <= 3330:
        w = 172
        Section_area = 218.70
        Section = 'H-400x400x172 kg/m'
    else:
        w = 0
        Section_area = 0
        Section = 'No Section to Selected'
    
    result.append((Section_area))  # เพิ่ม tuple ที่เก็บค่า Section area เข้าไปใน list ผลลัพธ์

# Assign your output to the OUT variable.
OUT = result
# ----------------------------------------
watch_3 = Watch(python_script)
volume = CodeBlock(A=watch_3, L=distanceTo) { (A/10000)*L; }
flatten_3 = List.Flatten(list=volume)
sum_2 = Math.Sum(values=flatten_3)
co2_ปร_มาณ = CodeBlock(volume=sum_2) { 3110.95*volume; }
python_script_2 = Python(IN[0]=section_req)  # CPython3
# ---------- python_script_2.python (113 lines) ----------
# Load the Python Standard and DesignScript Libraries
import sys
import clr
clr.AddReference('ProtoGeometry')
from Autodesk.DesignScript.Geometry import *

# The inputs to this node will be stored as a list in the IN variables.
Sx_list = IN[0]  # เปลี่ยนชื่อตัวแปรจาก Sx เป็น Sx_list เพื่อแสดงให้เห็นว่าเป็น list

# Place your code below this line
result = []  # สร้าง list เพื่อเก็บผลลัพธ์ที่ได้จากแต่ละค่าใน Sx_list
for Sx in Sx_list:
    if Sx <= 92:
        w = 21.3
        Section_area = 21.6
        Section = 'H-200x100x21.3 kg/m'
        # คำนวณเส้นรอบรูป
        perimeter = 2 * (200 + 100)  # เส้นรอบรูป = 2 * (ด้านยาว + ด้านสั้น)
    elif Sx <= 324:
        w = 29.6
        Section_area = 37.66
        Section = 'H-250x125x29.6 kg/m'
        # คำนวณเส้นรอบรูป
        perimeter = 2 * (250 + 125)  # เส้นรอบรูป = 2 * (ด้านยาว + ด้านสั้น)
    elif Sx <= 481:
        w = 36.7
        Section_area = 46.78
        Section = 'H-300x150x36.7 kg/m'
         # คำนวณเส้นรอบรูป
        perimeter = 2 * (300 + 150)  # เส้นรอบรูป = 2 * (ด้านยาว + ด้านสั้น)
    elif Sx <= 775:
        w = 49.6
        Section_area = 63.14
        Section = 'H-350x175x49.6 kg/m'
        # คำนวณเส้นรอบรูป
        perimeter = 2 * (350 + 175)  # เส้นรอบรูป = 2 * (ด้านยาว + ด้านสั้น)
    elif Sx <= 1190:
        w = 66
        Section_area = 84.12
        Section = 'H-400x200x66.0 kg/m'
        # คำนวณเส้นรอบรูป
        perimeter = 2 * (400 + 200)  # เส้นรอบรูป = 2 * (ด้านยาว + ด้านสั้น)
    elif Sx <= 1490:
        w = 76
        Section_area = 96.76
        Section = 'H-450x200x76.0 kg/m'
        # คำนวณเส้นรอบรูป
        perimeter = 2 * (450 + 200)  # เส้นรอบรูป = 2 * (ด้านยาว + ด้านสั้น)
    elif Sx <= 1910:
        w = 89.6
        Section_area = 114.20
        Section = 'H-500x200x89.6 kg/m'
        # คำนวณเส้นรอบรูป
        perimeter = 2 * (500 + 200)  # เส้นรอบรูป = 2 * (ด้านยาว + ด้านสั้น)
    elif Sx <= 2590:
        w = 106
        Section_area = 134.40
        Section = 'H-600x200x106 kg/m'
         # คำนวณเส้นรอบรูป
        perimeter = 2 * (600 + 200)  # เส้นรอบรูป = 2 * (ด้านยาว + ด้านสั้น)
    elif Sx <= 3530:
        w = 137
        Section_area = 174.50
        Section = 'H-600x300x137 kg/m'
         # คำนวณเส้นรอบรูป
        perimeter = 2 * (600 + 300)  # เส้นรอบรูป = 2 * (ด้านยาว + ด้านสั้น)
    elif Sx <= 7290:
        w = 210
        Section_area = 267.40
        Section = 'H-800x300x210 kg/m'
        # คำนวณเส้นรอบรูป
        perimeter = 2 * (800 + 300)  # เส้นรอบรูป = 2 * (ด้านยาว + ด้านสั้น)
    elif Sx <= 9140:
        w = 243
        Section_area = 309.80
        Section = 'H-900x300x243 kg/m'
        # คำนวณเส้นรอบรูป
        perimeter = 2 * (900 + 300)  # เส้นรอบรูป = 2 * (ด้านยาว + ด้านสั้น)
    elif Sx <= 219:
        w = 31.5
        Section = 'H-150x150x31.5 kg/m'
        # คำนวณเส้นรอบรูป
        perimeter = 2 * (150 + 150)  # เส้นรอบรูป = 2 * (ด้านยาว + ด้านสั้น)
    elif Sx <= 330:
        w = 40.2
        Section = 'H-175x175x40.2 kg/m'
        # คำนวณเส้นรอบรูป
        perimeter = 2 * (175 + 175)  # เส้นรอบรูป = 2 * (ด้านยาว + ด้านสั้น)
    elif Sx <= 472:
        w = 49.9
        Section = 'H-200x200x49.9 kg/m'  
        # คำนวณเส้นรอบรูป
        perimeter = 2 * (200 + 200)  # เส้นรอบรูป = 2 * (ด้านยาว + ด้านสั้น)
    elif Sx <= 1360:
        w = 94
        Section = 'H-300x300x94.0 kg/m'
        # คำนวณเส้นรอบรูป
        perimeter = 2 * (300 + 300)  # เส้นรอบรูป = 2 * (ด้านยาว + ด้านสั้น)
    elif Sx <= 3330:
        w = 172
        Section = 'H-400x400x172 kg/m'
        # คำนวณเส้นรอบรูป
        perimeter = 2 * (400 + 400)  # เส้นรอบรูป = 2 * (ด้านยาว + ด้านสั้น)
    else:
        w = 0
        Section_area = 0
        Section = 'No Section to Selected'
        perimeter = 0
 
    result.append((perimeter))  # เพิ่ม tuple ที่เก็บค่า w และ Section เข้าไปใน list ผลลัพธ์

# Assign your output to the OUT variable.
OUT = result
# ----------------------------------------
watch_4 = Watch(python_script_2)
code_block_19 = CodeBlock(circumference=watch_4) { 2*(circumference/1000); }
sum_3 = Math.Sum(values=code_block_19)
code_block_20 = CodeBlock(circumference=sum_3) { 4.28*circumference; }
total_weigth_of_steel = CodeBlock(volume=sum_2) { (volume*7850)/1000; }
python_script_3 = Python(IN[0]=section_req)  # CPython3
# ---------- python_script_3.python (68 lines) ----------
# Load the Python Standard and DesignScript Libraries
import sys
import clr
clr.AddReference('ProtoGeometry')
from Autodesk.DesignScript.Geometry import *

# The inputs to this node will be stored as a list in the IN variables.
Sx_list = IN[0]  # เปลี่ยนชื่อตัวแปรจาก Sx เป็น Sx_list เพื่อแสดงให้เห็นว่าเป็น list

# Place your code below this line
result = []  # สร้าง list เพื่อเก็บผลลัพธ์ที่ได้จากแต่ละค่าใน Sx_list
for Sx in Sx_list:
    if Sx <= 184:
        w = 21.3
        Section = 'H-200x100x21.3 kg/m'
    elif Sx <= 324:
        w = 29.6
        Section = 'H-250x125x29.6 kg/m'
    elif Sx <= 481:
        w = 36.7
        Section = 'H-300x150x36.7 kg/m'
    elif Sx <= 775:
        w = 49.6
        Section = 'H-350x175x49.6 kg/m'
    elif Sx <= 1190:
        w = 66
        Section = 'H-400x200x66.0 kg/m'
    elif Sx <= 1490:
        w = 76
        Section = 'H-450x200x76.0 kg/m'
    elif Sx <= 1910:
        w = 89.6
        Section = 'H-500x200x89.6 kg/m'
    elif Sx <= 2590:
        w = 106
        Section = 'H-600x200x106 kg/m'
    elif Sx <= 3530:
        w = 137
        Section = 'H-600x300x137 kg/m'
    elif Sx <= 7290:
        w = 210
        Section = 'H-800x300x210 kg/m'
    elif Sx <= 9140:
        w = 243
        Section = 'H-900x300x243 kg/m'
    elif Sx <= 219:
        w = 31.5
        Section = 'H-150x150x31.5 kg/m'
    elif Sx <= 330:
        w = 40.2
        Section = 'H-175x175x40.2 kg/m'
    elif Sx <= 472:
        w = 49.9
        Section = 'H-200x200x49.9 kg/m'  
    elif Sx <= 1360:
        w = 94
        Section = 'H-300x300x94.0 kg/m'
    elif Sx <= 3330:
        w = 172
        Section = 'H-400x400x172 kg/m'
    else:
        w = 0
        Section = 'No Section to Selected'
    
    result.append((w, Section))  # เพิ่ม tuple ที่เก็บค่า w และ Section เข้าไปใน list ผลลัพธ์

# Assign your output to the OUT variable.
OUT = result
# ----------------------------------------
watch_5 = Watch(python_script_3)

# group: Output
volume_2 = Watch(sum_2)  # graph output
embodie_carbon_from_member = Watch(co2_ปร_มาณ)  # graph output
embodie_carbon_form_joints = Watch(code_block_20)  # graph output
totol_weigth = Watch(total_weigth_of_steel)  # graph output

add = embodie_carbon_from_member + embodie_carbon_form_joints

# group (continued): Output
total_embodie_carbon = Watch(add)  # graph output

# group: คำนวณ Axial Force --> Section Req
code_block_21 = CodeBlock { "FXSX"; }
getMaxValuesList_2 = DynamoSimulation.RSA.RSAResults.Bar.BarStresses.GetMaxValuesList(name=code_block_21, analyticalBars=calculate.analyticalBars, loadCasesIds=code_block_3)
section_req_2 = CodeBlock(F=getMaxValuesList_2, Fy=code_block_5) { F/Fy; }
code_block_22 = CodeBlock(A=section_req_2, L=distanceTo) { (A/10000)*L; }

python_script_4 = Python(IN[0]=section_req)  # CPython3
# ---------- python_script_4.python (68 lines) ----------
# Load the Python Standard and DesignScript Libraries
import sys
import clr
clr.AddReference('ProtoGeometry')
from Autodesk.DesignScript.Geometry import *

# The inputs to this node will be stored as a list in the IN variables.
Sx_list = IN[0]  # เปลี่ยนชื่อตัวแปรจาก Sx เป็น Sx_list เพื่อแสดงให้เห็นว่าเป็น list

# Place your code below this line
result = []  # สร้าง list เพื่อเก็บผลลัพธ์ที่ได้จากแต่ละค่าใน Sx_list
for Sx in Sx_list:
    if Sx <= 184:
        w = 21.3
        Section = 'H-200x100x21.3 kg/m'
    elif Sx <= 324:
        w = 29.6
        Section = 'H-250x125x29.6 kg/m'
    elif Sx <= 481:
        w = 36.7
        Section = 'H-300x150x36.7 kg/m'
    elif Sx <= 775:
        w = 49.6
        Section = 'H-350x175x49.6 kg/m'
    elif Sx <= 1190:
        w = 66
        Section = 'H-400x200x66.0 kg/m'
    elif Sx <= 1490:
        w = 76
        Section = 'H-450x200x76.0 kg/m'
    elif Sx <= 1910:
        w = 89.6
        Section = 'H-500x200x89.6 kg/m'
    elif Sx <= 2590:
        w = 106
        Section = 'H-600x200x106 kg/m'
    elif Sx <= 3530:
        w = 137
        Section = 'H-600x300x137 kg/m'
    elif Sx <= 7290:
        w = 210
        Section = 'H-800x300x210 kg/m'
    elif Sx <= 9140:
        w = 243
        Section = 'H-900x300x243 kg/m'
    elif Sx <= 219:
        w = 31.5
        Section = 'H-150x150x31.5 kg/m'
    elif Sx <= 330:
        w = 40.2
        Section = 'H-175x175x40.2 kg/m'
    elif Sx <= 472:
        w = 49.9
        Section = 'H-200x200x49.9 kg/m'  
    elif Sx <= 1360:
        w = 94
        Section = 'H-300x300x94.0 kg/m'
    elif Sx <= 3330:
        w = 172
        Section = 'H-400x400x172 kg/m'
    else:
        w = 0
        Section = 'No Section to Selected'
    
    result.append((w))  # เพิ่ม tuple ที่เก็บค่า w และ Section เข้าไปใน list ผลลัพธ์

# Assign your output to the OUT variable.
OUT = result
# ----------------------------------------
watch_6 = Watch(python_script_4)
flatten_4 = List.Flatten(list=watch_6)
flatten_5 = List.Flatten(list=distanceTo)
